# Grasshopper definition mmm.gh (Grasshopper 1.0.7)
# plug-ins: Pufferfish

# ---- group: RH_IN:lenght
radius = Slider(10, range=5..20)

# ---- group: RH_IN:depth
count = Slider(5, range=2..20)

# ----
length = GetNumber(radius, AtLeast=1, AtMost=1, Maximum=1.797693135e+308, Minimum=-1.797693135e+308)
depth = GetNumber(count, AtLeast=1, AtMost=1, Maximum=1.797693135e+308, Minimum=-1.797693135e+308)

# ---- group: RH_IN:Number of Façades
radius_2 = Slider(1, range=0..4)

# ----
rectangle = Rectangle(Plane=PlaneXY(0, 0, 0), XSize=length, YSize=depth, Radius=0)  # -> Rectangle, Length

number_of_façades = GetNumber(radius_2, AtLeast=1, AtMost=1, Maximum=1.797693135e+308, Minimum=-1.797693135e+308)

surface = Surface(rectangle.Rectangle)
explode = Explode(Curve=rectangle.Rectangle, Recursive=True)  # -> Segments, Vertices
series = Series(Start=0, Step=1, Count=number_of_façades)

# ---- group: RH_IN:Trame de sructure
trame_de_sructure = Slider(4, range=2..6)

# ----
cull_index = CullIndex(List=explode.Segments, Indices=series, Wrap=True)
list_item = ListItem(List=explode.Segments, Index=series, Wrap=True)
curve = Curve(simplify(graft(list_item)))

# ---- group: trame structure
number_slider = Slider(4, range=0..10)

# ----
trame_de_sructure_2 = GetNumber(trame_de_sructure, AtLeast=1, AtMost=1, Maximum=1.797693135e+308, Minimum=-1.797693135e+308)

length_2 = Length(Curve=curve)
division = Division(A=length_2, B=trame_de_sructure_2)
integer = Integer(division)
divide_curve = DivideCurve(Curve=curve, Count=integer, Kinks=False)  # -> Points, Tangents, Parameters
shatter = Shatter(Curve=curve, Parameters=simplify(divide_curve.Parameters))

# ---- group: hauteur niveaux sup
number_slider_2 = Slider(3, range=0..10)

# ---- group: hauteur rdc
number_slider_3 = Slider(3.8, range=0..10)

# ----
unit_z = UnitZ(Factor=number_slider_3)
extrude = Extrude(Base=cull_index, Direction=unit_z)
extrude_2 = Extrude(Base=shatter, Direction=unit_z)

# ---- group: Encorbellement
number_slider_4 = Slider(1, range=0..10)

# ---- group: N Etages
number_slider_5 = Slider(3, range=0..10)

# ---- group: nombre de porte dentree
number_slider_6 = Slider(1, range=0..10)

# ---- group: seed facade compisition
number_slider_7 = Slider(4, range=0..10)

# ---- group: nombre de balcons
number_slider_8 = Slider(2, range=0..10)

# ---- group: hauteur garde corps terrasse
number_slider_9 = Slider(1, range=0..10)

# ---- group: nombre de garage
number_slider_10 = Slider(1, range=0..10)

# ---- group: hauteur garde corps
number_slider_11 = Slider(0.9, range=0..1)

# ---- group: largeur
number_slider_12 = Slider(1.5, range=0..10)

number_slider_13 = Slider(2.5, range=0..10)

number_slider_14 = Slider(1.5, range=0..10)

# ---- group: hauteur
number_slider_15 = Slider(2.8, range=0..10)

# ---- group: hauteur chassis-haut
number_slider_16 = Slider(0.4, range=0..2)

# ---- group: hauteur
number_slider_17 = Slider(2.8, range=0..10)

number_slider_18 = Slider(1.4, range=0..2)

# ---- group: appui fenetre
number_slider_19 = Slider(1, range=0..10)

# ---- group: hauteur
number_slider_20 = Slider(2.4, range=0..10)

# ----
pt = ConstructPoint(XCoordinate=0, YCoordinate=0, ZCoordinate=0)
swatch = ColourSwatch(SwatchColor=RGB(255, 0, 0))
swatch_2 = ColourSwatch(SwatchColor=RGB(255, 168, 168))

unit_z_2 = UnitZ(Factor=number_slider_2)
extrude_3 = Extrude(Base=shatter, Direction=unit_z_2)
extrude_4 = Extrude(Base=cull_index, Direction=unit_z_2)
surface_2 = Surface(extrude_3)
negative = Negative(Value=number_slider_4)
offset_surface = OffsetSurface(Surface=surface_2, Distance=negative, Retrim=True)
series_2 = Series(Start=number_slider_3, Step=number_slider_2, Count=number_slider_5)
unit_z_3 = UnitZ(Factor=series_2)
group = Group(Objects=extrude_4)
move = Move(Geometry=group, Motion=unit_z_3)  # -> Geometry, Transform

brep_wireframe = BrepWireframe(Brep=offset_surface, Density=-1)
list_item_2 = ListItem(List=brep_wireframe, Index=Slider(3, range=0..10), Wrap=True)
group_2 = Group(Objects=flatten([list_item_2, rectangle.Rectangle]))
bounding_box = BoundingBox(Content=group_2, Plane=PlaneXY(0, 0, 0))  # -> Box, Box_2
multiplication = Multiplication(A=number_slider_2, B=number_slider_5)
deconstruct_brep = DeconstructBrep(Brep=bounding_box.Box)  # -> Faces, Edges, Vertices
addition = Addition(A=number_slider_3, B=multiplication)
list_item_3 = ListItem(List=deconstruct_brep.Faces, Index=0, Wrap=True)
unit_z_4 = UnitZ(Factor=addition)
brep_wireframe_2 = BrepWireframe(Brep=list_item_3, Density=-1)
number_slider_21 = Slider(2, range=0..10)
move_2 = Move(Geometry=brep_wireframe_2, Motion=unit_z_4)  # -> Geometry, Transform
boundary_surfaces = BoundarySurfaces(Edges=move_2.Geometry)
cull_index_2 = CullIndex(List=move_2.Geometry, Indices=series, Wrap=True)
list_item_4 = ListItem(List=move_2.Geometry, Index=series, Wrap=True)
unit_z_5 = UnitZ(Factor=number_slider_9)
extrude_5 = Extrude(Base=list_item_4, Direction=unit_z_5)
extrude_6 = Extrude(Base=cull_index_2, Direction=unit_z_5)

group_3 = Group(Objects=offset_surface)

move_3 = Move(Geometry=group_3, Motion=unit_z_3)  # -> Geometry, Transform
ungroup = Ungroup(Group=move_3.Geometry)  # -> flatten(Objects)
surface_3 = Surface(ungroup)

surface_4 = Surface(extrude_2)
surface_5 = Surface(surface_4)
area = Area(Geometry=surface_5)  # -> Area, Centroid
random_reduce = RandomReduce(List=area.Centroid, Reduction=number_slider_6, Seed=number_slider_7)
surface_6 = Surface(surface_3)
find_similar_member = FindSimilarMember(Data=random_reduce, Set=area.Centroid)  # -> Hit, Index
area_2 = Area(Geometry=surface_6)  # -> Area, Centroid
cull_index_3 = CullIndex(List=surface_5, Indices=find_similar_member.Index, Wrap=True)
list_item_5 = ListItem(List=surface_5, Index=find_similar_member.Index, Wrap=True)
random_reduce_2 = RandomReduce(List=area_2.Centroid, Reduction=number_slider_8, Seed=number_slider_7)
surface_7 = Surface(list_item_5)
find_similar_member_2 = FindSimilarMember(Data=random_reduce_2, Set=area_2.Centroid)  # -> Hit, Index
area_3 = Area(Geometry=surface_7)  # -> Area, Centroid
list_item_6 = ListItem(List=surface_6, Index=find_similar_member_2.Index, Wrap=True)
cull_index_4 = CullIndex(List=surface_6, Indices=find_similar_member_2.Index, Wrap=True)
random_reduce_3 = RandomReduce(List=area_3.Centroid, Reduction=number_slider_10, Seed=number_slider_7)
find_similar_member_3 = FindSimilarMember(Data=random_reduce_3, Set=area_3.Centroid)  # -> Hit, Index
list_item_7 = ListItem(List=surface_7, Index=find_similar_member_3.Index, Wrap=True)
cull_index_5 = CullIndex(List=surface_7, Indices=find_similar_member_3.Index, Wrap=True)
merge = Merge(Data1=list_item_7, Data2=list_item_6)  # -> flatten(Result)
merge_2 = Merge(Data1=cull_index_3)  # -> flatten(Result)
merge_3 = Merge(Data1=cull_index_4)  # -> flatten(Result)
merge_4 = Merge(Data1=cull_index_5)  # -> flatten(Result)

surface_8 = Surface(merge_2)
area_4 = Area(Geometry=surface_8)  # -> Area, Centroid
brep_wireframe_3 = BrepWireframe(Brep=surface_8, Density=-1)
evaluate_surface = EvaluateSurface(Surface=surface_8, Point=area_4.Centroid)  # -> Point, Normal, UDirection, VDirection, Frame
list_item_8 = ListItem(List=brep_wireframe_3, Index=Slider(3, range=0..10), Wrap=True)
point_on_curve = PointOnCurve(list_item_8, parameter=0.5)
plane_origin = PlaneOrigin(Base=simplify(graft(evaluate_surface.Frame)), Origin=simplify(point_on_curve))
negative_2 = Negative(Value=number_slider_12)
construct_domain = ConstructDomain(DomainStart=expr("x/2", number_slider_12), DomainEnd=expr("x/2", negative_2))
rectangle_2 = Rectangle(Plane=plane_origin, XSize=number_slider_15, YSize=construct_domain, Radius=0)  # -> Rectangle, Length
surface_split = SurfaceSplit(Surface=simplify(surface_8), Curves=rectangle_2.Rectangle)
area_5 = Area(Geometry=rectangle_2.Rectangle)  # -> Area, Centroid
area_6 = Area(Geometry=surface_split)  # -> Area, Centroid
find_similar_member_4 = FindSimilarMember(Data=area_5.Centroid, Set=area_6.Centroid)  # -> Hit, Index
cull_index_6 = CullIndex(List=surface_split, Indices=find_similar_member_4.Index, Wrap=True)
list_item_9 = ListItem(List=surface_split, Index=find_similar_member_4.Index, Wrap=True)
surface_9 = Surface(list_item_9)
surface_10 = Surface(cull_index_6)
offset_surface_2 = OffsetSurface(Surface=surface_9, Distance=Slider(0.23, range=0..1), Retrim=True)
loft = Loft(
    Curves=[offset_surface_2, surface_9],
    Options={Adjust=True, Closed=False, LoftEnds=0, LoftSimp=0, LoftType=0, Rebuild=10, Refit=0.01})
merge_5 = Merge(Data1=surface_10, Data2=loft)
brep = Brep(merge_5)
surface_11 = Surface(offset_surface_2)

surface_12 = Surface(merge_4)
area_7 = Area(Geometry=surface_12)  # -> Area, Centroid
brep_wireframe_4 = BrepWireframe(Brep=surface_12, Density=-1)
evaluate_surface_2 = EvaluateSurface(Surface=surface_12, Point=area_7.Centroid)  # -> Point, Normal, UDirection, VDirection, Frame
list_item_10 = ListItem(List=brep_wireframe_4, Index=Slider(3, range=0..10), Wrap=True)
point_on_curve_2 = PointOnCurve(list_item_10, parameter=0.5)
plane_origin_2 = PlaneOrigin(Base=simplify(graft(evaluate_surface_2.Frame)), Origin=simplify(point_on_curve_2))
negative_3 = Negative(Value=number_slider_13)
construct_domain_2 = ConstructDomain(DomainStart=expr("x/2", number_slider_13), DomainEnd=expr("x/2", negative_3))
unit_z_6 = UnitZ(Factor=expr("x+0.2", number_slider_17))
rectangle_3 = Rectangle(Plane=plane_origin_2, XSize=number_slider_17, YSize=construct_domain_2, Radius=0)  # -> Rectangle, Length
rectangle_4 = Rectangle(Plane=plane_origin_2, XSize=number_slider_16, YSize=construct_domain_2, Radius=0)  # -> Rectangle, Length
move_4 = Move(Geometry=rectangle_4.Rectangle, Motion=unit_z_6)  # -> Geometry, Transform
surface_split_2 = SurfaceSplit(Surface=surface_12, Curves=[rectangle_3.Rectangle, move_4.Geometry])
area_8 = Area(Geometry=[rectangle_3.Rectangle, move_4.Geometry])  # -> Area, Centroid
area_9 = Area(Geometry=surface_split_2)  # -> Area, Centroid
find_similar_member_5 = FindSimilarMember(Data=area_8.Centroid, Set=area_9.Centroid)  # -> Hit, Index
cull_index_7 = CullIndex(List=surface_split_2, Indices=find_similar_member_5.Index, Wrap=True)
list_item_11 = ListItem(List=surface_split_2, Index=find_similar_member_5.Index, Wrap=True)
surface_13 = Surface(list_item_11)
surface_14 = Surface(cull_index_7)
curve_2 = Curve(graft(surface_13))
offset_surface_3 = OffsetSurface(Surface=surface_13, Distance=Slider(0.23, range=0..1), Retrim=True)
curve_3 = Curve(graft(offset_surface_3))
loft_2 = Loft(
    Curves=[curve_3, curve_2],
    Options={Adjust=True, Closed=False, LoftEnds=0, LoftSimp=0, LoftType=0, Rebuild=10, Refit=0.01})
merge_6 = Merge(Data1=surface_14, Data2=loft_2)
brep_2 = Brep(merge_6)
surface_15 = Surface(offset_surface_3)

surface_16 = Surface(merge)
area_10 = Area(Geometry=surface_16)  # -> Area, Centroid
brep_wireframe_5 = BrepWireframe(Brep=surface_16, Density=-1)
offset_surface_4 = OffsetSurface(Surface=surface_16, Distance=number_slider_4, Retrim=True)  # -> graft(Surface)
curve_4 = Curve(graft(surface_16))
evaluate_surface_3 = EvaluateSurface(Surface=surface_16, Point=area_10.Centroid)  # -> Point, Normal, UDirection, VDirection, Frame
list_item_12 = ListItem(List=brep_wireframe_5, Index=Slider(3, range=0..10), Wrap=True)
loft_3 = Loft(
    Curves=simplify([offset_surface_4, curve_4]),
    Options={Adjust=False, Closed=False, LoftEnds=0, LoftSimp=0, LoftType=0, Rebuild=10, Refit=0.01})
point_on_curve_3 = PointOnCurve(list_item_12, parameter=0.5)
plane_origin_3 = PlaneOrigin(Base=simplify(graft(evaluate_surface_3.Frame)), Origin=simplify(point_on_curve_3))
negative_4 = Negative(Value=number_slider_14)
construct_domain_3 = ConstructDomain(DomainStart=expr("x/2", number_slider_14), DomainEnd=expr("x/2", negative_4))
unit_z_7 = UnitZ(Factor=expr("x+0.2", number_slider_19))
rectangle_5 = Rectangle(Plane=plane_origin_3, XSize=number_slider_18, YSize=construct_domain_3, Radius=0)  # -> Rectangle, Length
move_5 = Move(Geometry=rectangle_5.Rectangle, Motion=unit_z_7)  # -> Geometry, Transform
surface_split_3 = SurfaceSplit(Surface=graft(surface_16), Curves=simplify(graft(move_5.Geometry)))
area_11 = Area(Geometry=surface_split_3)  # -> Area, Centroid
area_12 = Area(Geometry=move_5.Geometry)  # -> Area, Centroid
find_similar_member_6 = FindSimilarMember(Data=area_12.Centroid, Set=area_11.Centroid)  # -> Hit, Index
cull_index_8 = CullIndex(List=surface_split_3, Indices=find_similar_member_6.Index, Wrap=True)
list_item_13 = ListItem(List=surface_split_3, Index=find_similar_member_6.Index, Wrap=True)
surface_17 = Surface(simplify(list_item_13))
surface_18 = Surface(cull_index_8)
offset_surface_5 = OffsetSurface(Surface=surface_17, Distance=Slider(0.23, range=0..1), Retrim=True)
loft_4 = Loft(
    Curves=[surface_17, offset_surface_5],
    Options={Adjust=True, Closed=False, LoftEnds=0, LoftSimp=0, LoftType=0, Rebuild=10, Refit=0.01})
merge_7 = Merge(Data1=surface_18, Data2=loft_4)
brep_3 = Brep(merge_7)
surface_19 = Surface(offset_surface_5)
brep_4 = Brep(loft_3)

surface_20 = Surface(merge_3)
brep_wireframe_6 = BrepWireframe(Brep=surface_20, Density=-1)
offset_surface_6 = OffsetSurface(Surface=surface_20, Distance=number_slider_4, Retrim=True)
unit_z_8 = UnitZ(Factor=number_slider_11)
list_item_14 = ListItem(List=brep_wireframe_6, Index=Slider(3, range=0..10), Wrap=True)
surface_21 = Surface(offset_surface_6)
extrude_7 = Extrude(Base=list_item_14, Direction=unit_z_8)
area_13 = Area(Geometry=surface_21)  # -> Area, Centroid
brep_wireframe_7 = BrepWireframe(Brep=surface_21, Density=-1)
offset_surface_7 = OffsetSurface(Surface=extrude_7, Distance=negative, Retrim=True)
evaluate_surface_4 = EvaluateSurface(Surface=surface_21, Point=area_13.Centroid)  # -> Point, Normal, UDirection, VDirection, Frame
list_item_15 = ListItem(List=brep_wireframe_7, Index=Slider(3, range=0..10), Wrap=True)
loft_5 = Loft(
    Curves=[extrude_7, offset_surface_7],
    Options={Adjust=True, Closed=False, LoftEnds=0, LoftSimp=0, LoftType=0, Rebuild=10, Refit=0.01})
point_on_curve_4 = PointOnCurve(list_item_15, parameter=0.5)
deconstruct_brep_2 = DeconstructBrep(Brep=loft_5)  # -> Faces, Edges, Vertices
cull_index_9 = CullIndex(List=deconstruct_brep_2.Faces, Indices=Slider(5, range=0..10), Wrap=True)
plane_origin_4 = PlaneOrigin(Base=simplify(graft(evaluate_surface_4.Frame)), Origin=simplify(point_on_curve_4))
merge_8 = Merge(Data1=extrude_7, Data2=cull_index_9)
rectangle_6 = Rectangle(Plane=plane_origin_4, XSize=number_slider_20, YSize=construct_domain_3, Radius=0)  # -> Rectangle, Length
surface_split_4 = SurfaceSplit(Surface=surface_21, Curves=rectangle_6.Rectangle)
area_14 = Area(Geometry=rectangle_6.Rectangle)  # -> Area, Centroid
area_15 = Area(Geometry=surface_split_4)  # -> Area, Centroid
find_similar_member_7 = FindSimilarMember(Data=area_14.Centroid, Set=area_15.Centroid)  # -> Hit, Index
cull_index_10 = CullIndex(List=surface_split_4, Indices=find_similar_member_7.Index, Wrap=True)
list_item_16 = ListItem(List=surface_split_4, Index=find_similar_member_7.Index, Wrap=True)
surface_22 = Surface(list_item_16)
surface_23 = Surface(cull_index_10)
offset_surface_8 = OffsetSurface(Surface=surface_22, Distance=Slider(0.23, range=0..1), Retrim=True)
loft_6 = Loft(
    Curves=[offset_surface_8, surface_22],
    Options={Adjust=True, Closed=False, LoftEnds=0, LoftSimp=0, LoftType=0, Rebuild=10, Refit=0.01})
merge_9 = Merge(Data1=surface_23, Data2=loft_6)
surface_24 = Surface(offset_surface_8)
brep_5 = Brep(merge_9)
surface_25 = Surface(merge_8)

merge_10 = Merge(
    Data1=brep,
    Data2=brep_2,
    Data3=brep_3,
    Data4=brep_5,
    Data6=surface_25,
    Data7=boundary_surfaces,
    Data8=list_item_3,
    Data9=extrude_5)  # -> flatten(Result)
merge_11 = Merge(Data1=surface_11, Data2=surface_15, Data3=surface_19, Data4=surface_24)
merge_12 = Merge(Data1=brep_4, Data2=extrude_6, Data3=move.Geometry, Data4=extrude)
ungroup_2 = Ungroup(Group=[merge_11, merge_12, merge_10])  # -> flatten(Objects)
bbox = BoundingBox(Content=ungroup_2, Plane=PlaneXY(0, 0, 0), UnionBox=True)  # -> Box, Box_2
debrep = DeconstructBrep(Brep=bbox.Box)  # -> Faces, Edges, Vertices
item = ListItem(List=debrep.Faces, Index=Slider(4, range=0..10), Wrap=True)
area_16 = Area(Geometry=item)  # -> Area, Centroid
move2pt = MoveToPoint(Geometry=ungroup_2, PointA=area_16.Centroid, PointB=pt)  # -> Moved, Vector, Transform

bbox_2 = BoundingBox(Content=move2pt.Moved, Plane=PlaneXY(0, 0, 0), UnionBox=True)  # -> Box, Box_2
area_17 = Area(Geometry=bbox_2.Box)  # -> Area, Centroid
scale = Scale(Geometry=bbox_2.Box, Center=area_17.Centroid, Factor=Slider(2, range=0..10))  # -> Geometry, Transform
wires = BrepWireframe(Brep=scale.Geometry, Density=-1)  # -> flatten(Wireframe)

mesh = MeshBrep(
    Brep=move2pt.Moved,
    Settings={GridMaxCount=0, GridMinCount=16, JaggedSeams=False, MaxEdgeLength=0, MinEdgeLength=0.0001, MinTolerance=0, Refine=True, RefineAngle=0, RelativeTolerance=0.65, SimplePlanes=True, Tolerance=0})  # -> flatten(Mesh)
wires_2 = BrepWireframe(Brep=move2pt.Moved, Density=-1)  # -> flatten(Wireframe)
explode_2 = Explode(Curve=wires_2, Recursive=True)  # -> flatten(Segments), Vertices
area_18 = Area(Geometry=mesh)  # -> Area, Centroid
lng = ListLength(List=mesh)
series_3 = Series(Start=0, Step=1, Count=lng)
pdecon = Deconstruct(Point=area_18.Centroid)  # -> XComponent, YComponent, ZComponent
gradient = Gradient(
    LowerLimit=0,
    UpperLimit=lng,
    Parameter=series_3,
    stops=[0.1: RGB(255, 255, 255), 0.2: RGB(0, 0, 0), 0.3: RGB(255, 255, 255), 0.4: RGB(0, 0, 0), 0.5: RGB(255, 255, 255), 0.6: RGB(0, 0, 0), 0.7: RGB(255, 255, 255), 0.8: RGB(0, 0, 0), 0.9: RGB(255, 255, 255)])
dash = DashPattern(Curve=explode_2.Segments, Pattern=Slider(0.2, range=0..10))  # -> flatten(Dashes), Gaps
sort = SortList(Keys=pdecon.ZComponent, ValuesA=mesh)  # -> Keys, ValuesA

# ---- group: RH_OUT:edges
crv = Curve(flatten(dash.Dashes))

# ----
mcol = MeshColours(Mesh=sort.ValuesA, Colours="0,99,65")
explode_3 = Explode(Curve=wires, Recursive=True)  # -> flatten(Segments), Vertices
lng_2 = ListLength(List=flatten(crv))
dash_2 = DashPattern(Curve=explode_3.Segments, Pattern=Slider(2.2, range=0..10))  # -> flatten(Dashes), Gaps
series_4 = Series(Start=0, Step=1, Count=lng_2)
lng_3 = ListLength(List=flatten(mcol))

# ---- group: RH_OUT:edges2
crv_2 = Curve(flatten(dash_2.Dashes))  # disabled

# ---- group: RH_OUT:mesh
mesh_2 = Mesh(flatten(mcol))

# ----
series_5 = Series(Start=0, Step=1, Count=lng_3)
lng_4 = ListLength(List=flatten(crv_2))
series_6 = Series(Start=0, Step=1, Count=lng_4)
repeat = RepeatData(Data=ColourSwatch(SwatchColor=RGB(255, 255, 255)), Length=lng_2)
c_script = CSharpScript(crv=crv, color=repeat)  # -> out, A; inputs crv: Curve, color: Color
# ---------- c_script: C# ----------
    var c = color.R + "," + color.G + "," + color.B;
    crv.SetUserString("color", c);
    A = crv;
# ---------- end c_script ----------

# ---- group: RH_OUT:edges
curve_5 = Curve(flatten(c_script.A))  # disabled

# ----
repeat_2 = RepeatData(Data=ColourSwatch(SwatchColor=RGB(47, 255, 0)), Length=lng_4)
material = CreateMaterial(Diffuse=gradient, Specular=RGB(255, 255, 255), Emission=RGB(0, 0, 0), Transparency=0, Shine=0)
c_script_2 = CSharpScript(crv=crv_2, color=repeat_2)  # -> out, A; inputs crv: Curve, color: Color; same code as c_script
preview = CustomPreview(Material=material)
c_script_3 = CSharpScript(materials=simplify(graft(material)))  # -> out, str; inputs objects: tree, materials: tree; disabled
# ---------- c_script_3: C# ----------
    if(objects.BranchCount != materials.BranchCount) return;

    var doc = new Rhino.FileIO.File3dm();

    //go through branches
    for(int i = 0; i < objects.BranchCount; i++)
    {
      var mat = materials.Branches[i][0] as Rhino.Display.DisplayMaterial;
      var objs = objects.Branches[i];

      var material = new Rhino.DocObjects.Material();
      material.DiffuseColor = mat.Diffuse;
      material.EmissionColor = mat.Emission;
      material.Transparency = mat.Transparency;
      material.Shine = mat.Shine;
      material.SpecularColor = mat.Specular;

      var atts = new Rhino.DocObjects.ObjectAttributes();
      atts.MaterialSource = Rhino.DocObjects.ObjectMaterialSource.MaterialFromObject;

      doc.AllMaterials.Add(material);
      atts.MaterialIndex = i;

      for(int j = 0; j < objs.Count; j++)
      {
        var obj = objs[j] as Rhino.Geometry.GeometryBase;
        Print(obj.ToString());

        switch(obj.ObjectType)
        {
          case Rhino.DocObjects.ObjectType.Curve:
            doc.Objects.AddCurve(obj as Curve, atts);
            break;
          case Rhino.DocObjects.ObjectType.Mesh:
            doc.Objects.AddMesh(obj as Mesh, atts);
            break;
        }
      }

    }

    var fwo = new Rhino.FileIO.File3dmWriteOptions();
    fwo.Version = 7;
    var arr = doc.ToByteArray(fwo);

    str = Convert.ToBase64String(arr);

    doc.Dispose();
# ---------- end c_script_3 ----------

c_script_4 = CSharpScript(mesh=mesh_2, color=gradient)  # -> out, A; inputs mesh: GeometryBase, color: Color; disabled
# ---------- c_script_4: C# ----------
    var c = color.R + "," + color.G + "," + color.B;
    mesh.SetUserString("color", c);
    A = mesh;
# ---------- end c_script_4 ----------

# ---- group: RH_OUT:edges2
curve_6 = Curve(flatten(c_script_2.A))  # disabled

# ---- group: RH_OUT:docString
txt = Text(c_script_3.str)  # disabled

# ---- group: RH_OUT:mesh
mesh_3 = Mesh(flatten(c_script_4.A))
